# Grasshopper definition RemeshTest.gh (Grasshopper 1.0.5)
# plug-ins: FlexComputation

srf = Surface(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)
mesh = MeshBrep(
    Brep=srf,
    Settings={GridMaxCount=0, GridMinCount=16, JaggedSeams=False, MaxEdgeLength=0, MinEdgeLength=0.0001, MinTolerance=0, Refine=True, RefineAngle=0, RelativeTolerance=0.65, SimplePlanes=True, Tolerance=0})
flex = FlexComputation(Mesh=mesh, EdgeLength="10")
